# Grasshopper definition read_shp_extrude_building_empty_values.gh (Grasshopper 1.0.7)
# Copyright: Coprat

# ---- group: Anchor Location
# ShrimpGIS 1.0.2
# 
# How to extrude buildings. Dataset with empty data.
# -
# This example uses shp file provided by Gismo
# ++++++++++++++++++++++++++++
# Requirements:
# - Rhino6
# - ShrimpGIS
# ++++++++++++++++++++++++++++
# Author: Antonello Di Nunzio
# License: GPL V.3.0+
panel = Panel("BOSTON MA(USA)")
shrimp_location = ShrimpGISLocation(name=panel, latitude="42.3615101", longitude="-71.0616249")  # -> location; inputs anchor_point: Point3d
# ---------- shrimp_location: Python ----------
# ShrimpGIS: A basic plugin to read and write shapefile (GPL).
# This file is part of ShrimpGIS.
#
# Copyright (c) 2020, Antonello Di Nunzio <antonellodinunzio@gmail.com>.
# You should have received a copy of the GNU General Public License
# along with ShrimpGIS; If not, see <http://www.gnu.org/licenses/>.
# 
# @license GPL-3.0+ <http://spdx.org/licenses/GPL-3.0+>

"""
Construct a ShrimpGIS Location.
    Args:
        _name_: Name of Location.
        _latitude_: Latitude of Location WGS84 [float].
        _longitude_: Longitude of Location WGS84 [float].
        _altitude_: Altitude of Location in meter [float]. Use it for shapefile with Z values.
        _anchor_point_: Rhino point to use as anchor point of Location.
    
    Returns:
        location: ShrimpGIS Location.
"""

ghenv.Component.Name = "ShrimpGIS Location"
ghenv.Component.NickName = "shrimp_location"
ghenv.Component.Message = "1.0.0"
ghenv.Component.Category = "ShrimpGIS"
ghenv.Component.SubCategory = "0 || Settings"
try: ghenv.Component.AdditionalHelpFromDocStrings = "1"
except: pass

import scriptcontext as sc
import os
import sys
##################ShrimpGIS#####################
try:
    user_path = os.getenv("APPDATA")
    sys.path.append(user_path)
    from shrimp_gis import __version__
    from shrimp_gis import Location
    ghenv.Component.Message = __version__
except ImportError as e:
    raise ImportError("\nFailed to import ShrimpGIS: {0}\n\nCheck your 'shrimp_gis' folder in {1}".format(e, os.getenv("APPDATA")))
################################################

def main():
    
    location = Location()
    
    if _name_: location.name = _name_
    if _latitude_: location.latitude = _latitude_
    if _longitude_: location.longitude = _longitude_
    if _altitude_: location.altitude = _altitude_
    if _anchor_point_: location.anchor_point = _anchor_point_
    
    return location

location = main()
# ---------- end shrimp_location ----------

# ---- group: Replace with a full path of shp file
python = GhPythonScript()  # -> shp
# ---------- python: Python ----------
"""Get current path - for examples only"""

__author__ = "antonellodinunzio"

import os
file_name = ghenv.Component.OnPingDocument().FilePath
shp = os.path.join(os.path.dirname(file_name), "shp\\multipolygons.shp")
# ---------- end python ----------

# ---- group: 1
toggle = BooleanToggle(False)

# ---- group: Read
shrimp_read_shp = ShrimpGISReadShp(shp_file=python, location=shrimp_location, run_it=toggle)  # -> read_me, field, geometry, port, missing_geometry; inputs run_it: Boolean
# ---------- shrimp_read_shp: Python ----------
# ShrimpGIS: A basic plugin to read and write shapefile (GPL).
# This file is part of ShrimpGIS.
#
# Copyright (c) 2020, Antonello Di Nunzio <antonellodinunzio@gmail.com>.
# You should have received a copy of the GNU General Public License
# along with ShrimpGIS; If not, see <http://www.gnu.org/licenses/>.
# 
# @license GPL-3.0+ <http://spdx.org/licenses/GPL-3.0+>

"""
Use this component to read shapefiles.
-
Supported shapefile types are:
    1) POINT
    2) POLYLINE
    3) POLYGON
    4) POINTZ
    5) POLYLINEZ
    6) POLYGONZ
-
Remark: Only WGS84 (EPSG:4326) reference system is supported.
If your shp use another coordinate system you have to reproject it using a GIS software (e.g. QGIS).

    Args:
        _shp_file: Complete path with extension of a shapefile. E.g. C:\Example\shapefile.shp
        _location_: ShrimpGIS Location.
        run_it_: Set it to true to run component.
    Returns:
        read_me: Message for users.
        field: ShrimpGIS Fields attached to GIS geometries.
        geometry: Imported geometries in Rhino world.
        -
        They are arranged in GH tree in "Maintain" mode. Branches of missing geometries are deleted automatically.
        -------------------:
        missing_geometry: Some geometries can be not import correctly. Here you can find Id of missing geometries.
        -
        Use this output to create Paths or use it as List to clear Field values from missing geometries.
"""

ghenv.Component.Name = "ShrimpGIS Read Shp"
ghenv.Component.NickName = "shrimp_read_shp"
ghenv.Component.Category = "ShrimpGIS"
ghenv.Component.SubCategory = "1 || IO"
try: ghenv.Component.AdditionalHelpFromDocStrings = "1"
except: pass

import scriptcontext as sc
import os
import sys
import Grasshopper
import Rhino

##################ShrimpGIS#####################
try:
    user_path = os.getenv("APPDATA")
    sys.path.append(user_path)
    from shrimp_gis import __version__, Location
    from shrimp_gis.io import ShpReader
    from shrimp_gis.io import get_rh_point_from_latlon
    ghenv.Component.Message = __version__
except ImportError as e:
    raise ImportError("\nFailed to import ShrimpGIS: {0}\n\nCheck your 'shrimp_gis' folder in {1}".format(e, os.getenv("APPDATA")))
################################################


def main():
    
    level = Grasshopper.Kernel.GH_RuntimeMessageLevel.Remark
    
    if not _shp_file:
        print("Connect a compatible shapefile to read.\nThen set run_it to 'True'.")
        return [None]*3
    
    reader = ShpReader()
    location = Location() if not _location_ else _location_
    
    if run_it_:
        if (reader.is_shp_file_wgs84(_shp_file)):
            reader.read_shp_file(_shp_file)
            
            
            if (reader.level == "not supported"):
                ghenv.Component.AddRuntimeMessage(level, "I am Sorry, {0} file type is not supported" \
                " by shp reader components.".format(reader.type_name))
                return [None]*3
            else:
                gh_points = get_rh_point_from_latlon(reader.points, location)
                
                if (reader.level == "supported with z"):
                    ghenv.Component.AddRuntimeMessage(level, "{0} file type supported." \
                    " This shp file has Z values.".format(reader.type_name))
                    
                    for pts, zs in zip(gh_points, reader.z):
                        for pt, z in zip(pts, zs):
                            pt.Z = z - location.altitude
                
                geometry, missing_geometry = reader.post_processing(gh_points, _shp_file)
                field = reader.fields
                
                return field, geometry, missing_geometry
        else:
            ghenv.Component.AddRuntimeMessage(level, "Only WGS84 (EPSG:4326) is supported." \
            "Please reproject vectors using a GIS software (e.g. QGIS) before importing it.")
            return [None]*3
    else:
        return [None]*3

field, geometry, missing_geometry = main()
# ---------- end shrimp_read_shp ----------

# ----
item = ListItem(List=shrimp_read_shp.field, Index="14", Wrap=True)

panel_2 = Panel(item)

# ---- group: Decompose Fields
shrimp_dec_field = ShrimpGISDecomposeField(field=item)  # -> read_me, name, values; inputs field: list
# ---------- shrimp_dec_field: Python ----------
# ShrimpGIS: A basic plugin to read and write shapefile (GPL).
# This file is part of ShrimpGIS.
#
# Copyright (c) 2020, Antonello Di Nunzio <antonellodinunzio@gmail.com>.
# You should have received a copy of the GNU General Public License
# along with ShrimpGIS; If not, see <http://www.gnu.org/licenses/>.
# 
# @license GPL-3.0+ <http://spdx.org/licenses/GPL-3.0+>

"""
Use this component to decompose ShrimpGIS Field and extract values.
    
    input:
        _field: Column with rows that comes from "ShrimpGIS Field" or "ShrimpGIS Write Shp".
    output:
        read_me: Message for users.
        name: Name of column.
        values: Records (rows) associated to geometries.
"""

ghenv.Component.Name = "ShrimpGIS Decompose Field"
ghenv.Component.NickName = "shrimp_dec_field"
ghenv.Component.Category = "ShrimpGIS"
ghenv.Component.SubCategory = "1 || IO"
try: ghenv.Component.AdditionalHelpFromDocStrings = "2"
except: pass

import scriptcontext as sc
import os
import sys
##################ShrimpGIS#####################
try:
    user_path = os.getenv("APPDATA")
    sys.path.append(user_path)
    from shrimp_gis import __version__
    from shrimp_gis.io import ShpReader
    ghenv.Component.Message = __version__
except ImportError as e:
    raise ImportError("\nFailed to import ShrimpGIS: {0}\n\nCheck your 'shrimp_gis' folder in {1}".format(e, os.getenv("APPDATA")))
################################################

def main():
    
    return ShpReader.decompose_fields(_field)

if (filter(None,_field)):
    values, name = main()
# ---------- end shrimp_dec_field ----------

# ---- group: Remove empty value
len = TextLength(Text=shrimp_dec_field.values)
equals = Equality(FirstNumber=len, SecondNumber=0)  # -> Equality, Inequality
cull = CullPattern(List=shrimp_dec_field.values, CullPattern=equals.Inequality)

# ---- group: Get index
index = ItemIndex(List=shrimp_dec_field.values, Item=cull)

# ---- group: Filter Building
branch = TreeBranch(Tree=shrimp_read_shp.geometry, Path=index, MaintainPaths=True)

# ---- group: Extrude
Z = UnitZ(Factor=cull)
extr = Extrude(Base=branch, Direction=graft(Z))
