# Grasshopper definition write_raster_file_from_img.gh (Grasshopper 1.0.7)
# Copyright: Coprat

# ---- group: Create square surface. Domains 0 to 1
number_slider = Slider(25, range=1..100)
crv = Curve(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)
boundary = BoundarySurfaces(Edges=crv)
sdivide = DivideSurface(Surface=reparameterize(boundary), UCount=number_slider, VCount=number_slider)  # -> Points, Normals, Parameters

# ---- group: Anchor Location
# ShrimpGIS 1.0.3
# 
# From img to GIS raster
# ++++++++++++++++++++++++++++
# Requirements:
# - Rhino6
# - ShrimpGIS
# ++++++++++++++++++++++++++++
# Author: Antonello Di Nunzio
# License: GPL V.3.0+
panel = Panel("BOSTON MA(USA)")
shrimp_location = ShrimpGISLocation(name=panel, latitude="42.3615101", longitude="-71.0616249")  # -> location; inputs anchor_point: Point3d
# ---------- shrimp_location: Python ----------
# ShrimpGIS: A basic plugin to read and write shapefile (GPL).
# This file is part of ShrimpGIS.
#
# Copyright (c) 2020, Antonello Di Nunzio <antonellodinunzio@gmail.com>.
# You should have received a copy of the GNU General Public License
# along with ShrimpGIS; If not, see <http://www.gnu.org/licenses/>.
# 
# @license GPL-3.0+ <http://spdx.org/licenses/GPL-3.0+>

"""
Construct a ShrimpGIS Location.
    Args:
        _name_: Name of Location.
        _latitude_: Latitude of Location WGS84 [float].
        _longitude_: Longitude of Location WGS84 [float].
        _altitude_: Altitude of Location in meter [float]. Use it for shapefile with Z values.
        _anchor_point_: Rhino point to use as anchor point of Location.
    
    Returns:
        location: ShrimpGIS Location.
"""

ghenv.Component.Name = "ShrimpGIS Location"
ghenv.Component.NickName = "shrimp_location"
ghenv.Component.Message = "1.0.0"
ghenv.Component.Category = "ShrimpGIS"
ghenv.Component.SubCategory = "0 || Settings"
try: ghenv.Component.AdditionalHelpFromDocStrings = "1"
except: pass

import scriptcontext as sc
import os
import sys
##################ShrimpGIS#####################
try:
    user_path = os.getenv("APPDATA")
    sys.path.append(user_path)
    from shrimp_gis import __version__
    from shrimp_gis import Location
    ghenv.Component.Message = __version__
except ImportError as e:
    raise ImportError("\nFailed to import ShrimpGIS: {0}\n\nCheck your 'shrimp_gis' folder in {1}".format(e, os.getenv("APPDATA")))
################################################

def main():
    
    location = Location()
    
    if _name_: location.name = _name_
    if _latitude_: location.latitude = _latitude_
    if _longitude_: location.longitude = _longitude_
    if _altitude_: location.altitude = _altitude_
    if _anchor_point_: location.anchor_point = _anchor_point_
    
    return location

location = main()
# ---------- end shrimp_location ----------

# ---- group: Check order
flip = FlipMatrix(Data=sdivide.Points)
points = PointList(Points=flatten(flip), Size="1")

# ---- group: Open Image. Domains 0 to 1
image = ImageSampler(sdivide.Parameters, Filter="Value", Interpolate=False, Umax=1, Umin=0, Vmax=1, Vmin=0, Wrap=1)
dom = ConstructDomain(DomainStart="1", DomainEnd="10")
remap = RemapNumbers(Value=image, Source=Domain(0, 1), Target=dom)  # -> Mapped, Clipped

# ---- group: Calculate pixel size in meter
dim = Dimensions(Surface=boundary)  # -> UDimension, VDimension
division = Division(A=dim.UDimension, B=number_slider)

# ----
item = ListItem(List=flatten(sdivide.Points), Index=0, Wrap=True)

# ---- group: Flip matrix
flip_2 = FlipMatrix(Data=remap.Mapped)  # -> flatten(Data)

# ---- group: Base point of raster file (left corner)
shrimp_point = ShrimpGISPoint(point=flatten(item), location=shrimp_location)  # -> shp_point; inputs point: list of Point3d
# ---------- shrimp_point: Python ----------
# ShrimpGIS: A basic plugin to read and write shapefile (GPL).
# This file is part of ShrimpGIS.
#
# Copyright (c) 2020, Antonello Di Nunzio <antonellodinunzio@gmail.com>.
# You should have received a copy of the GNU General Public License
# along with ShrimpGIS; If not, see <http://www.gnu.org/licenses/>.
# 
# @license GPL-3.0+ <http://spdx.org/licenses/GPL-3.0+>

"""
Construct a ShrimpGIS Point.
    Args:
        _point: Rhino points.
        _location_: ShrimpGIS Location.
    
    Returns:
        shp_point: ShrimpGIS Point [plugin::type::n.point].
"""

ghenv.Component.Name = "ShrimpGIS Point"
ghenv.Component.NickName = "shrimp_point"
ghenv.Component.Category = "ShrimpGIS"
ghenv.Component.SubCategory = "0 || Settings"
try: ghenv.Component.AdditionalHelpFromDocStrings = "2"
except: pass

import scriptcontext as sc
import os
import sys
##################ShrimpGIS#####################
try:
    user_path = os.getenv("APPDATA")
    sys.path.append(user_path)
    from shrimp_gis import __version__
    from shrimp_gis import Location
    from shrimp_gis.geometry import ShpPoint
    from shrimp_gis.io import get_latlon_from_location
    ghenv.Component.Message = __version__
except ImportError as e:
    raise ImportError("\nFailed to import ShrimpGIS: {0}\n\nCheck your 'shrimp_gis' folder in {1}".format(e, os.getenv("APPDATA")))
################################################

import scriptcontext as sc
import Grasshopper
import Rhino

warning = Grasshopper.Kernel.GH_RuntimeMessageLevel.Warning

def is_in_meter():
    units = sc.doc.ModelUnitSystem
    if `units` != 'Rhino.UnitSystem.Meters': return False
    return True

def main():
    
    if not is_in_meter():
        ghenv.Component.AddRuntimeMessage(warning, "Rhino model have to be in meter.")
        return
    
    location = Location() if not _location_ else _location_
    
    if _point:
        shp_point = [ShpPoint(pt) for pt in _point]
        for pt in shp_point:
            pt.coordinates = get_latlon_from_location([pt.geometry], location)
        
        return shp_point

shp_point = main()
# ---------- end shrimp_point ----------

# ----
addition = Addition(A=number_slider, B=1)

# ---- group: Get UTM information
shrimp_get_utm = ShrimpGISGetUTM(shp_point=shrimp_point)  # -> utm_easting, utm_northing, zone_number, zone_letter
# ---------- shrimp_get_utm: Python ----------
# ShrimpGIS: A basic plugin to read and write shapefile (GPL).
# This file is part of ShrimpGIS.
#
# Copyright (c) 2020, Antonello Di Nunzio <antonellodinunzio@gmail.com>.
# You should have received a copy of the GNU General Public License
# along with ShrimpGIS; If not, see <http://www.gnu.org/licenses/>.
# 
# @license GPL-3.0+ <http://spdx.org/licenses/GPL-3.0+>

"""
Get UTM information from Shrimp point.
-
The UTM (Universal Transverse Mercator) system divides the surface of the earth up into a grid. Each grid is identified by a number, a zone number and a letter.
    Args:
        _shp_point: Shrimp point.
    
    Returns:
        utm_easting: Easting value of UTM coordinate.
        utm_northing: Northing value of UTM coordinate.
        zone_number: UTM zone number.
        -
        The UTM system divides the Earth into 60 zones, each 6° of longitude in width. Zone 1 covers longitude 180° to 174° W.
        zone_letter: UTM zone letter.
"""

ghenv.Component.Name = "ShrimpGIS Get UTM"
ghenv.Component.NickName = "shrimp_get_utm"
ghenv.Component.Message = "1.0.0"
ghenv.Component.Category = "ShrimpGIS"
ghenv.Component.SubCategory = "2 || Utils"
try: ghenv.Component.AdditionalHelpFromDocStrings = "1"
except: pass

import scriptcontext as sc
import os
import sys
##################ShrimpGIS#####################
try:
    user_path = os.getenv("APPDATA")
    sys.path.append(user_path)
    from shrimp_gis import __version__
    from shrimp_gis import Location
    from shrimp_gis.geometry import ShpPoint
    from shrimp_gis.io import get_utm_detail_from_location
    
    ghenv.Component.Message = __version__
except ImportError as e:
    raise ImportError("\nFailed to import ShrimpGIS: {0}\n\nCheck your 'shrimp_gis' folder in {1}".format(e, os.getenv("APPDATA")))
################################################

def main():
    
    if _shp_point:
        
        coordinates = _shp_point.coordinates[0]
        location = Location("ShrimpGIS-Location", coordinates[0], coordinates[1], _shp_point.points)
        
        return get_utm_detail_from_location(location)
        
    return None, None, None, None

utm_easting, utm_northing, zone_number, zone_letter = main()
# ---------- end shrimp_get_utm ----------
shrimp_utm_prj = ShrimpGISUTMPRJ(shp_point=shrimp_point)  # -> EPSG, prj_text
# ---------- shrimp_utm_prj: Python ----------
# ShrimpGIS: A basic plugin to read and write shapefile (GPL).
# This file is part of ShrimpGIS.
#
# Copyright (c) 2020, Antonello Di Nunzio <antonellodinunzio@gmail.com>.
# You should have received a copy of the GNU General Public License
# along with ShrimpGIS; If not, see <http://www.gnu.org/licenses/>.
# 
# @license GPL-3.0+ <http://spdx.org/licenses/GPL-3.0+>

"""
Get EPSG code and *.prj content for a specific Shrimp point. Use it with 'ShrimpGIS Write Asc'.
-
This component uses internet connection. It retrieves PROJCS string of UTM (datum WGS84).
-
EPSG code is an ID between 1024-32767 which is part of a public registry of spatial reference systems (EPSG registry).
PRJ file contains the projected coordinate system you are referring to. It is an important file to map correctly raster file as well vector files.
    Args:
        _shp_point: Shrimp point to use to get UTM projection reference system.
    
    Returns:
        EPSG: EPSG code.
        prj_text: Text to write into a *.prj file. Connect it to 'ShrimpGIS Write Asc'.
"""

ghenv.Component.Name = "ShrimpGIS UTM PRJ"
ghenv.Component.NickName = "shrimp_utm_prj"
ghenv.Component.Message = "1.0.0"
ghenv.Component.Category = "ShrimpGIS"
ghenv.Component.SubCategory = "2 || Utils"
try: ghenv.Component.AdditionalHelpFromDocStrings = "1"
except: pass

import scriptcontext as sc
import os
import sys
##################ShrimpGIS#####################
try:
    user_path = os.getenv("APPDATA")
    sys.path.append(user_path)
    from shrimp_gis import __version__
    from shrimp_gis.io import get_epsg_from_shp_point, get_prj_text_from_EPSG
    
    ghenv.Component.Message = __version__
except ImportError as e:
    raise ImportError("\nFailed to import ShrimpGIS: {0}\n\nCheck your 'shrimp_gis' folder in {1}".format(e, os.getenv("APPDATA")))
################################################

def main():
    
    if _shp_point:
        EPSG = get_epsg_from_shp_point(_shp_point)
        prj_text = get_prj_text_from_EPSG(EPSG)
        
        return EPSG, prj_text
    return None, None

EPSG, prj_text = main()
# ---------- end shrimp_utm_prj ----------

# ---- group: Create ASCII matrix
shrimp_esri_ascii = ShrimpGISEsriASCII(values=flip_2, num_x=addition, num_y=addition)  # -> ASCII_matrix; inputs values: list, num_x: Int32, num_y: Int32
# ---------- shrimp_esri_ascii: Python ----------
# ShrimpGIS: A basic plugin to read and write shapefile (GPL).
# This file is part of ShrimpGIS.
#
# Copyright (c) 2020, Antonello Di Nunzio <antonellodinunzio@gmail.com>.
# You should have received a copy of the GNU General Public License
# along with ShrimpGIS; If not, see <http://www.gnu.org/licenses/>.
# 
# @license GPL-3.0+ <http://spdx.org/licenses/GPL-3.0+>

"""
Construct a ShrimpGIS Matrix to write Esri ASCII Raster format.
    Args:
        _values: Values to map into a rectangular ASCII matrix [list].
        -
        Values must be from left-right bottom-up.
        How does result should looks like (left-right bottom-up)?
        ...
        5 6 7 8 9
        0 1 2 3 4
        _num_x: Number of pixels at x [int].
        _num_y: Number of pixels at y [int].
    
    Returns:
        ASCII_matrix: ShrimpGIS Matrix.
"""

ghenv.Component.Name = "ShrimpGIS Esri ASCII"
ghenv.Component.NickName = "shrimp_esri_ascii"
ghenv.Component.Message = "1.0.0"
ghenv.Component.Category = "ShrimpGIS"
ghenv.Component.SubCategory = "0 || Settings"
try: ghenv.Component.AdditionalHelpFromDocStrings = "1"
except: pass

import scriptcontext as sc
import os
import sys
##################ShrimpGIS#####################
try:
    user_path = os.getenv("APPDATA")
    sys.path.append(user_path)
    from shrimp_gis import __version__
    from shrimp_gis.geometry import Matrix
    
    ghenv.Component.Message = __version__
except ImportError as e:
    raise ImportError("\nFailed to import ShrimpGIS: {0}\n\nCheck your 'shrimp_gis' folder in {1}".format(e, os.getenv("APPDATA")))
################################################

def main():
    
    if _values and _num_x and _num_y:
        matrix = Matrix(_values, _num_x, _num_y)
        
        return matrix
        
    return None

ASCII_matrix = main()
# ---------- end shrimp_esri_ascii ----------

# ---- group: 2
toggle = BooleanToggle(False)

# ---- group: Replace with a path where to save file
python = GhPythonScript()  # -> folder
# ---------- python: Python ----------
"""Get current path - for examples only"""

__author__ = "antonellodinunzio"

import os
file_name = ghenv.Component.OnPingDocument().FilePath
folder = os.path.join(os.path.dirname(file_name), "out")
# ---------- end python ----------

# ----
data = Data(division)

# ---- group: Write raster file
shrimp_write_asc = ShrimpGISWriteAsc(
    ASCII_matrix=shrimp_esri_ascii,
    pixel_size=data,
    utm_easting=shrimp_get_utm.utm_easting,
    utm_northing=shrimp_get_utm.utm_northing,
    prj_text=shrimp_utm_prj.prj_text,
    folder=python,
    name="voronoi",
    run_it=toggle)  # -> read_me, asc_file; inputs run_it: Boolean
# ---------- shrimp_write_asc: Python ----------
# ShrimpGIS: A basic plugin to read and write shapefile (GPL).
# This file is part of ShrimpGIS.
#
# Copyright (c) 2020, Antonello Di Nunzio <antonellodinunzio@gmail.com>.
# You should have received a copy of the GNU General Public License
# along with ShrimpGIS; If not, see <http://www.gnu.org/licenses/>.
# 
# @license GPL-3.0+ <http://spdx.org/licenses/GPL-3.0+>

"""
It writes Esri ASCII Raster.
-
It is a raster format file you can open with QGIS, for example.
    Args:
        _ASCII_matrix: ShrimpGIS ASCII matrix.
        _pixel_size: Dimension (Length or Width) in meter of pixel [float].
        _utm_easting: Easting value of UTM coordinate [float].
        _utm_northing: Northing value of UTM coordinate [float].
        _prj_text: Text to write into *.prj file. Connect output of 'ShrimpGIS UTM PRJ'.
        _folder: Path of directory where you want to save asc file. For example, "C:\Example".
        _name_: Name of asc which you want to save on your machine. Default name is 'shrimp_gis_asc'.
        run_it_: Set it to True to write asc file.
    
    Returns:
        read_me: Message for users.
        asc_file: Complete path with extension of the raster file.
"""

ghenv.Component.Name = "ShrimpGIS Write Asc"
ghenv.Component.NickName = "shrimp_write_asc"
ghenv.Component.Message = "1.0.0"
ghenv.Component.Category = "ShrimpGIS"
ghenv.Component.SubCategory = "1 || IO"
try: ghenv.Component.AdditionalHelpFromDocStrings = "1"
except: pass

import scriptcontext as sc
import os
import sys
##################ShrimpGIS#####################
try:
    user_path = os.getenv("APPDATA")
    sys.path.append(user_path)
    from shrimp_gis import __version__
    from shrimp_gis.io import AscWriter
    
    ghenv.Component.Message = __version__
except ImportError as e:
    raise ImportError("\nFailed to import ShrimpGIS: {0}\n\nCheck your 'shrimp_gis' folder in {1}".format(e, os.getenv("APPDATA")))
################################################


def main():
    
    name = "shrimp_gis_asc" if _name_ == None else _name_
    
    if _ASCII_matrix and _pixel_size and _utm_easting and _utm_northing and _prj_text and _folder and run_it_:
        
        asc_file = AscWriter(_ASCII_matrix, _pixel_size, _utm_easting, _utm_northing)
        file = asc_file.get_asc(_folder, name, _prj_text)
        
        return file
        
    return

asc_file = main()
if not asc_file: print("Please, connect _ASCII_matrix, _pixel_size, _utm_easting, _utm_northing, _prj_text, _folder and set run_it_ to 'True'.")
# ---------- end shrimp_write_asc ----------

# ----
panel_2 = Panel(shrimp_write_asc.asc_file)
