# Grasshopper definition write_shp_with_z_values_reference_altitude.gh (Grasshopper 1.0.7)
# Copyright: Coprat

# ---- group: It will be the reference height of ShrimpGIS objects
number_slider = Slider(45, range=0..45)

# ---- group: Anchor Location
# ShrimpGIS 1.0.2
# 
# Write surface with z values. Play with reference altitude
# ++++++++++++++++++++++++++++
# Requirements:
# - Rhino6
# - ShrimpGIS
# ++++++++++++++++++++++++++++
# Author: Antonello Di Nunzio
# License: GPL V.3.0+
panel = Panel("BOSTON MA(USA)")
shrimp_location = ShrimpGISLocation(name=panel, latitude="42.3615101", longitude="-71.0616249", altitude=number_slider)  # -> location; inputs anchor_point: Point3d
# ---------- shrimp_location: Python ----------
# ShrimpGIS: A basic plugin to read and write shapefile (GPL).
# This file is part of ShrimpGIS.
#
# Copyright (c) 2020, Antonello Di Nunzio <antonellodinunzio@gmail.com>.
# You should have received a copy of the GNU General Public License
# along with ShrimpGIS; If not, see <http://www.gnu.org/licenses/>.
# 
# @license GPL-3.0+ <http://spdx.org/licenses/GPL-3.0+>

"""
Construct a ShrimpGIS Location.
    Args:
        _name_: Name of Location.
        _latitude_: Latitude of Location WGS84 [float].
        _longitude_: Longitude of Location WGS84 [float].
        _altitude_: Altitude of Location in meter [float]. Use it for shapefile with Z values.
        _anchor_point_: Rhino point to use as anchor point of Location.
    
    Returns:
        location: ShrimpGIS Location.
"""

ghenv.Component.Name = "ShrimpGIS Location"
ghenv.Component.NickName = "shrimp_location"
ghenv.Component.Message = "1.0.0"
ghenv.Component.Category = "ShrimpGIS"
ghenv.Component.SubCategory = "0 || Settings"
try: ghenv.Component.AdditionalHelpFromDocStrings = "1"
except: pass

import scriptcontext as sc
import os
import sys
##################ShrimpGIS#####################
try:
    user_path = os.getenv("APPDATA")
    sys.path.append(user_path)
    from shrimp_gis import __version__
    from shrimp_gis import Location
    ghenv.Component.Message = __version__
except ImportError as e:
    raise ImportError("\nFailed to import ShrimpGIS: {0}\n\nCheck your 'shrimp_gis' folder in {1}".format(e, os.getenv("APPDATA")))
################################################

def main():
    
    location = Location()
    
    if _name_: location.name = _name_
    if _latitude_: location.latitude = _latitude_
    if _longitude_: location.longitude = _longitude_
    if _altitude_: location.altitude = _altitude_
    if _anchor_point_: location.anchor_point = _anchor_point_
    
    return location

location = main()
# ---------- end shrimp_location ----------

# ---- group: ShrimpGIS PolygonZ
srf = Surface([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])
shrimp_polygonz = ShrimpGISPolygonZ(surface=flatten(srf), location=shrimp_location)  # -> shp_polygon; inputs surface: list of Brep, num: Int32
# ---------- shrimp_polygonz: Python ----------
# ShrimpGIS: A basic plugin to read and write shapefile (GPL).
# This file is part of ShrimpGIS.
#
# Copyright (c) 2020, Antonello Di Nunzio <antonellodinunzio@gmail.com>.
# You should have received a copy of the GNU General Public License
# along with ShrimpGIS; If not, see <http://www.gnu.org/licenses/>.
# 
# @license GPL-3.0+ <http://spdx.org/licenses/GPL-3.0+>

"""
Construct a ShrimpGIS PolygonZ. Use it if you have z values.
    Args:
        _surface: A Rhino or Grasshopper Brep/Surface to export.
        _location_: ShrimpGIS Location.
        _num_: Number of point to consider for discretization of curves. If it is a polyline component automatically recognizes points.
        -
        Default value is 10.
    
    Returns:
        shp_polygon: ShrimpGIS Polygon [plugin::type::n.polygon].
"""

ghenv.Component.Name = "ShrimpGIS PolygonZ"
ghenv.Component.NickName = "shrimp_polygonz"
ghenv.Component.Category = "ShrimpGIS"
ghenv.Component.SubCategory = "0 || Settings"
try: ghenv.Component.AdditionalHelpFromDocStrings = "2"
except: pass

import scriptcontext as sc
import os
import sys
##################ShrimpGIS#####################
try:
    user_path = os.getenv("APPDATA")
    sys.path.append(user_path)
    from shrimp_gis import __version__
    from shrimp_gis import Location
    from shrimp_gis.geometry import ShpPolygonZ
    from shrimp_gis.io import get_latlon_from_location
    ghenv.Component.Message = __version__
except ImportError as e:
    raise ImportError("\nFailed to import ShrimpGIS: {0}\n\nCheck your 'shrimp_gis' folder in {1}".format(e, os.getenv("APPDATA")))
################################################

import scriptcontext as sc
import Grasshopper
import Rhino

warning = Grasshopper.Kernel.GH_RuntimeMessageLevel.Warning

def is_in_meter():
    units = sc.doc.ModelUnitSystem
    if `units` != 'Rhino.UnitSystem.Meters': return False
    return True

def main():
    
    if not is_in_meter():
        ghenv.Component.AddRuntimeMessage(warning, "Rhino model have to be in meter.")
        return
    
    location = Location() if not _location_ else _location_
    num = 10 if not _num_ else _num_
    
    if _surface:
        shp_polygon = [ShpPolygonZ(srf, num) for srf in _surface]
        for geo in shp_polygon:
            geo.coordinates = []
            for pts in geo.points:
                geo.coordinates.append(get_latlon_from_location(pts, location, True))
        
        return shp_polygon

shp_polygon = main()
# ---------- end shrimp_polygonz ----------

# ----
panel_2 = Panel(shrimp_polygonz)

# ---- group: 1
toggle = BooleanToggle(False)

# ---- group: Replace with a dir path where to save shp
python = GhPythonScript()  # -> shp
# ---------- python: Python ----------
"""Get current path - for examples only"""

__author__ = "antonellodinunzio"

import os
file_name = ghenv.Component.OnPingDocument().FilePath
shp = os.path.join(os.path.dirname(file_name), "out")
# ---------- end python ----------

# ----
# Use QGIS3D or QGIS+Threejs
# to see where surface is located by location altitude
shrimp_write_shp = ShrimpGISWriteShp(shp_geometry=flatten(shrimp_polygonz), folder=python, name="buildings", run_it=toggle)  # -> read_me, shp_file; inputs field: list, shp_geometry: list, run_it: Boolean
# ---------- shrimp_write_shp: Python ----------
# ShrimpGIS: A basic plugin to read and write shapefile (GPL).
# This file is part of ShrimpGIS.
#
# Copyright (c) 2020, Antonello Di Nunzio <antonellodinunzio@gmail.com>.
# You should have received a copy of the GNU General Public License
# along with ShrimpGIS; If not, see <http://www.gnu.org/licenses/>.
# 
# @license GPL-3.0+ <http://spdx.org/licenses/GPL-3.0+>

"""
It writes ESRI Shapefiles WGS84.
    Args:
        _field_: ShrimpGIS Fields to add to GIS geometries.
        -
        If nothing added to this input, it will be created just one column called UUID.
        _shp_geometry: Geometry to write into shapefile.
        -
        Connect a type of following
        - ShrimpGIS point 
        - ShrimpGIS curve 
        - ShrimpGIS polygon 
        - ShrimpGIS mesh
        _folder: Path of directory where you want to save a shapefile. For example, "C:\Example".
        _name_: Name of shapefile which you want to save on your machine. Default name is <GEOTYPE>.
        run_it_: Set it to True to write shapefile.
    
    Returns:
        read_me: Message for users.
        shp_file: Complete path with extension of the shapefile.
"""

ghenv.Component.Name = "ShrimpGIS Write Shp"
ghenv.Component.NickName = "shrimp_write_shp"
ghenv.Component.Category = "ShrimpGIS"
ghenv.Component.SubCategory = "1 || IO"
try: ghenv.Component.AdditionalHelpFromDocStrings = "1"
except: pass

import scriptcontext as sc
import os
import sys
import Grasshopper
import Rhino

##################ShrimpGIS#####################
try:
    user_path = os.getenv("APPDATA")
    sys.path.append(user_path)
    from shrimp_gis import __version__
    from shrimp_gis.io import ShpWriter
    ghenv.Component.Message = __version__
except ImportError as e:
    raise ImportError("\nFailed to import ShrimpGIS: {0}\n\nCheck your 'shrimp_gis' folder in {1}".format(e, os.getenv("APPDATA")))
################################################

warning = Grasshopper.Kernel.GH_RuntimeMessageLevel.Warning

def main():
    
    main_type = _shp_geometry[0].name
    
    name = main_type if _name_ == None else _name_
    
    if None in _field_: print("There is an invalid field."); return
    
    if (run_it_):
        shp_write = ShpWriter()
        result = shp_write.write_shp_file(_folder, name, _shp_geometry, _field_)
        
        if result == False:
                ghenv.Component.AddRuntimeMessage(warning, "Please make sure you are using just one geometry type (e.g. all points) and count of value of fields are equals to geometries count.")
        else:
            return result


shp_file = main() if _shp_geometry and run_it_ and _folder != None else None
if not shp_file:
    print("Add shp_geometry and folder.\nThen set run_it to 'True'.")
else:
    print("File written.")
# ---------- end shrimp_write_shp ----------
