# Grasshopper definition write_shp_with_z_values.gh (Grasshopper 1.0.7)
# Copyright: Coprat

# ShrimpGIS 1.0.2
# 
# Curve with Z values. Mount Vesuvius!
# ++++++++++++++++++++++++++++
# Requirements:
# - Rhino6
# - ShrimpGIS
# - Gismo
# ++++++++++++++++++++++++++++
# Author: Antonello Di Nunzio
# License: GPL V.3.0+
gismo = Gismo_Gismo(gismoFolder="c:\gismo")  # -> readMe; plug-in component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

# ---- group: Anchor Location
panel = Panel("40.8225844")
panel_2 = Panel("14.4269773")
panel_3 = Panel("Mount Vesuvius (NAPLES)")
shrimp_location = ShrimpGISLocation(name=panel_3, latitude=panel, longitude=panel_2, altitude="1136")  # -> location; inputs anchor_point: Point3d
# ---------- shrimp_location: Python ----------
# ShrimpGIS: A basic plugin to read and write shapefile (GPL).
# This file is part of ShrimpGIS.
#
# Copyright (c) 2020, Antonello Di Nunzio <antonellodinunzio@gmail.com>.
# You should have received a copy of the GNU General Public License
# along with ShrimpGIS; If not, see <http://www.gnu.org/licenses/>.
# 
# @license GPL-3.0+ <http://spdx.org/licenses/GPL-3.0+>

"""
Construct a ShrimpGIS Location.
    Args:
        _name_: Name of Location.
        _latitude_: Latitude of Location WGS84 [float].
        _longitude_: Longitude of Location WGS84 [float].
        _altitude_: Altitude of Location in meter [float]. Use it for shapefile with Z values.
        _anchor_point_: Rhino point to use as anchor point of Location.
    
    Returns:
        location: ShrimpGIS Location.
"""

ghenv.Component.Name = "ShrimpGIS Location"
ghenv.Component.NickName = "shrimp_location"
ghenv.Component.Message = "1.0.0"
ghenv.Component.Category = "ShrimpGIS"
ghenv.Component.SubCategory = "0 || Settings"
try: ghenv.Component.AdditionalHelpFromDocStrings = "1"
except: pass

import scriptcontext as sc
import os
import sys
##################ShrimpGIS#####################
try:
    user_path = os.getenv("APPDATA")
    sys.path.append(user_path)
    from shrimp_gis import __version__
    from shrimp_gis import Location
    ghenv.Component.Message = __version__
except ImportError as e:
    raise ImportError("\nFailed to import ShrimpGIS: {0}\n\nCheck your 'shrimp_gis' folder in {1}".format(e, os.getenv("APPDATA")))
################################################

def main():
    
    location = Location()
    
    if _name_: location.name = _name_
    if _latitude_: location.latitude = _latitude_
    if _longitude_: location.longitude = _longitude_
    if _altitude_: location.altitude = _altitude_
    if _anchor_point_: location.anchor_point = _anchor_point_
    
    return location

location = main()
# ---------- end shrimp_location ----------

# ---- group: Gismo / 1
toggle = BooleanToggle(False)

# ---- group: Gismo
createlocation = Gismo_CreateLocation(locationName=panel_3, latitude=panel, longitude=panel_2)  # -> location; plug-in component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
terraingenerator = Gismo_TerrainGenerator(
    location=createlocation,
    radius="800",
    source=0,
    type=1,
    standThickness=0,
    numOfContours="100",
    bakeIt=False,
    runIt=toggle)  # -> readMe, terrain, origin, elevation, elevationContours, title; inputs radius: Int32, source: Int32, type: Int32, origin: Point3d, numOfContours: Int32, legendBakePar: tree, bakeIt: Boolean, runIt: Boolean; plug-in component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

# ---- group: Shrimp CurveZ
shrimp_curvez = ShrimpGISCurveZ(curve=flatten(terraingenerator.elevationContours), location=shrimp_location, num=Slider(100, range=2..100))  # -> shp_curve; inputs curve: list of Curve, num: Int32
#   port curve: A Rhino or Grasshopper Brep/Surface to export.
# ---------- shrimp_curvez: Python ----------
# ShrimpGIS: A basic plugin to read and write shapefile (GPL).
# This file is part of ShrimpGIS.
#
# Copyright (c) 2020, Antonello Di Nunzio <antonellodinunzio@gmail.com>.
# You should have received a copy of the GNU General Public License
# along with ShrimpGIS; If not, see <http://www.gnu.org/licenses/>.
# 
# @license GPL-3.0+ <http://spdx.org/licenses/GPL-3.0+>

"""
Construct a ShrimpGIS CurveZ. Use it if you have z values.
    Args:
        _surface: A Rhino or Grasshopper Curve to export.
        _location_: ShrimpGIS Location.
        _num_: Number of point to consider for discretization of curves. If it is a polyline component automatically recognizes points.
        -
        Default value is 10.
    
    Returns:
        shp_curve: ShrimpGIS Curve [plugin::type::n.point].
"""

ghenv.Component.Name = "ShrimpGIS CurveZ"
ghenv.Component.NickName = "shrimp_curvez"
ghenv.Component.Category = "ShrimpGIS"
ghenv.Component.SubCategory = "0 || Settings"
try: ghenv.Component.AdditionalHelpFromDocStrings = "2"
except: pass

import scriptcontext as sc
import os
import sys
##################ShrimpGIS#####################
try:
    user_path = os.getenv("APPDATA")
    sys.path.append(user_path)
    from shrimp_gis import __version__
    from shrimp_gis import Location
    from shrimp_gis.geometry import ShpCurveZ
    from shrimp_gis.io import get_latlon_from_location
    ghenv.Component.Message = __version__
except ImportError as e:
    raise ImportError("\nFailed to import ShrimpGIS: {0}\n\nCheck your 'shrimp_gis' folder in {1}".format(e, os.getenv("APPDATA")))
################################################

import scriptcontext as sc
import Grasshopper
import Rhino

warning = Grasshopper.Kernel.GH_RuntimeMessageLevel.Warning

def is_in_meter():
    units = sc.doc.ModelUnitSystem
    if `units` != 'Rhino.UnitSystem.Meters': return False
    return True

def main():
    
    if not is_in_meter():
        ghenv.Component.AddRuntimeMessage(warning, "Rhino model have to be in meter.")
        return
    
    location = Location() if not _location_ else _location_
    num = 10 if not _num_ else _num_
    
    if _curve:
        shp_curve = [ShpCurveZ(crv, num) for crv in _curve]
        for geo in shp_curve:
            geo.coordinates = get_latlon_from_location(geo.points, location, True)
        
        return shp_curve

shp_curve = main()
# ---------- end shrimp_curvez ----------

# ----
panel_4 = Panel(shrimp_curvez)

# ---- group: 1
toggle_2 = BooleanToggle(False)

# ---- group: Replace with a dir path where to save shp
python = GhPythonScript()  # -> shp
# ---------- python: Python ----------
"""Get current path - for examples only"""

__author__ = "antonellodinunzio"

import os
file_name = ghenv.Component.OnPingDocument().FilePath
shp = os.path.join(os.path.dirname(file_name), "out")
# ---------- end python ----------

# ----
shrimp_write_shp = ShrimpGISWriteShp(shp_geometry=flatten(shrimp_curvez), folder=python, name="terrain", run_it=toggle_2)  # -> read_me, shp_file; inputs field: list, shp_geometry: list, run_it: Boolean
# ---------- shrimp_write_shp: Python ----------
# ShrimpGIS: A basic plugin to read and write shapefile (GPL).
# This file is part of ShrimpGIS.
#
# Copyright (c) 2020, Antonello Di Nunzio <antonellodinunzio@gmail.com>.
# You should have received a copy of the GNU General Public License
# along with ShrimpGIS; If not, see <http://www.gnu.org/licenses/>.
# 
# @license GPL-3.0+ <http://spdx.org/licenses/GPL-3.0+>

"""
It writes ESRI Shapefiles WGS84.
    Args:
        _field_: ShrimpGIS Fields to add to GIS geometries.
        -
        If nothing added to this input, it will be created just one column called UUID.
        _shp_geometry: Geometry to write into shapefile.
        -
        Connect a type of following
        - ShrimpGIS point 
        - ShrimpGIS curve 
        - ShrimpGIS polygon 
        - ShrimpGIS mesh
        _folder: Path of directory where you want to save a shapefile. For example, "C:\Example".
        _name_: Name of shapefile which you want to save on your machine. Default name is <GEOTYPE>.
        run_it_: Set it to True to write shapefile.
    
    Returns:
        read_me: Message for users.
        shp_file: Complete path with extension of the shapefile.
"""

ghenv.Component.Name = "ShrimpGIS Write Shp"
ghenv.Component.NickName = "shrimp_write_shp"
ghenv.Component.Category = "ShrimpGIS"
ghenv.Component.SubCategory = "1 || IO"
try: ghenv.Component.AdditionalHelpFromDocStrings = "1"
except: pass

import scriptcontext as sc
import os
import sys
import Grasshopper
import Rhino

##################ShrimpGIS#####################
try:
    user_path = os.getenv("APPDATA")
    sys.path.append(user_path)
    from shrimp_gis import __version__
    from shrimp_gis.io import ShpWriter
    ghenv.Component.Message = __version__
except ImportError as e:
    raise ImportError("\nFailed to import ShrimpGIS: {0}\n\nCheck your 'shrimp_gis' folder in {1}".format(e, os.getenv("APPDATA")))
################################################

warning = Grasshopper.Kernel.GH_RuntimeMessageLevel.Warning

def main():
    
    main_type = _shp_geometry[0].name
    
    name = main_type if _name_ == None else _name_
    
    if None in _field_: print("There is an invalid field."); return
    
    if (run_it_):
        shp_write = ShpWriter()
        result = shp_write.write_shp_file(_folder, name, _shp_geometry, _field_)
        
        if result == False:
                ghenv.Component.AddRuntimeMessage(warning, "Please make sure you are using just one geometry type (e.g. all points) and count of value of fields are equals to geometries count.")
        else:
            return result


shp_file = main() if _shp_geometry and run_it_ and _folder != None else None
if not shp_file:
    print("Add shp_geometry and folder.\nThen set run_it to 'True'.")
else:
    print("File written.")
# ---------- end shrimp_write_shp ----------
