# Grasshopper definition read_geojson_features.gh (Grasshopper 1.0.7)

# ShrimpGIS 1.0.3
# 
# Read Geojson features
# ++++++++++++++++++++++++++++
# Requirements:
# - Rhino6
# - ShrimpGIS
# References:
# geojson file: https://gist.github.com/carlvlewis/02631ee66f172936c454a4a1e12c5eff
# ++++++++++++++++++++++++++++
# Author: Antonello Di Nunzio
# License: GPL V.3.0+
panel = Panel("scmpd-precinct-polygons.geojson")

# ---- group: Replace with a dir path where to save shp
python = GhPythonScript()  # -> geojson
# ---------- python: Python ----------
"""Get current path - for examples only"""

__author__ = "antonellodinunzio"

import os
file_name = ghenv.Component.OnPingDocument().FilePath
geojson = os.path.join(os.path.dirname(file_name), "geojson/")
# ---------- end python ----------

# ----
shrimp_location = ShrimpGISLocation(name="MyLocation", latitude="32.058466", longitude="-81.123542")  # -> location; inputs anchor_point: Point3d
# ---------- shrimp_location: Python ----------
# ShrimpGIS: A basic plugin to read and write shapefile (GPL).
# This file is part of ShrimpGIS.
#
# Copyright (c) 2020, Antonello Di Nunzio <antonellodinunzio@gmail.com>.
# You should have received a copy of the GNU General Public License
# along with ShrimpGIS; If not, see <http://www.gnu.org/licenses/>.
# 
# @license GPL-3.0+ <http://spdx.org/licenses/GPL-3.0+>

"""
Construct a ShrimpGIS Location.
    Args:
        _name_: Name of Location.
        _latitude_: Latitude of Location WGS84 [float].
        _longitude_: Longitude of Location WGS84 [float].
        _altitude_: Altitude of Location in meter [float]. Use it for shapefile with Z values.
        _anchor_point_: Rhino point to use as anchor point of Location.
    
    Returns:
        location: ShrimpGIS Location.
"""

ghenv.Component.Name = "ShrimpGIS Location"
ghenv.Component.NickName = "shrimp_location"
ghenv.Component.Message = "1.0.0"
ghenv.Component.Category = "ShrimpGIS"
ghenv.Component.SubCategory = "0 || Settings"
try: ghenv.Component.AdditionalHelpFromDocStrings = "1"
except: pass

import scriptcontext as sc
import os
import sys
##################ShrimpGIS#####################
try:
    user_path = os.getenv("APPDATA")
    sys.path.append(user_path)
    from shrimp_gis import __version__
    from shrimp_gis import Location
    ghenv.Component.Message = __version__
except ImportError as e:
    raise ImportError("\nFailed to import ShrimpGIS: {0}\n\nCheck your 'shrimp_gis' folder in {1}".format(e, os.getenv("APPDATA")))
################################################

def main():
    
    location = Location()
    
    if _name_: location.name = _name_
    if _latitude_: location.latitude = _latitude_
    if _longitude_: location.longitude = _longitude_
    if _altitude_: location.altitude = _altitude_
    if _anchor_point_: location.anchor_point = _anchor_point_
    
    return location

location = main()
# ---------- end shrimp_location ----------
join = TextJoin(Text=[python, panel])

# ---- group: 1
toggle = BooleanToggle(False)

# ----
shrimp_read_geojson = ShrimpGISReadGeojson(geojson_file=join, location=shrimp_location, run_it=toggle)  # -> read_me, field, type, geometry; inputs run_it: Boolean
# ---------- shrimp_read_geojson: Python ----------
# ShrimpGIS: A basic plugin to read and write shapefile (GPL).
# This file is part of ShrimpGIS.
#
# Copyright (c) 2020, Antonello Di Nunzio <antonellodinunzio@gmail.com>.
# You should have received a copy of the GNU General Public License
# along with ShrimpGIS; If not, see <http://www.gnu.org/licenses/>.
# 
# @license GPL-3.0+ <http://spdx.org/licenses/GPL-3.0+>

"""
Use this component to read geojson file.
-
Supported geojson types are:
    1) Point
    2) MultiPoint
    3) LineString
    4) MultiLineString
    5) Polygon
    6) MultiPolygon
-
More info about geojson compliant structure supported by ShrimpGIS here: https://en.wikipedia.org/wiki/GeoJSON
-
Remark: Only WGS84 (EPSG:4326) reference system is supported.
The coordinate reference system for all GeoJSON coordinates is a geographic coordinate reference system, using the World Geodetic System 1984 (WGS84) datum, with longitude and latitude units of decimal degrees. This is equivalent to the coordinate reference system identified by the Open Geospatial Consortium (OGC) URN urn:ogc:def:crs:OGC::CRS84.
-
reference: https://cran.r-project.org/web/packages/geojsonio/vignettes/geojson_spec.html
    Args:
        _geojson_file_: Complete path with extension of a geojson file. E.g. C:\Example\my_json.json
        -
        Note it supports geojson standard rfc7946. To see compatible structure see here: https://en.wikipedia.org/wiki/GeoJSON
        _location_: ShrimpGIS Location.
        run_it_: Set it to true to run component.
    Returns:
        read_me: Message for users.
        field: ShrimpGIS Fields attached to GIS geometries.
        type: Imported geojson type in Rhino world.
        -
        Note that a geojson file supports multiple geometry type at the same time.
        geometry: Imported geometries in Rhino world.
"""

ghenv.Component.Name = "ShrimpGIS Read Geojson"
ghenv.Component.NickName = "shrimp_read_geojson"
ghenv.Component.Category = "ShrimpGIS"
ghenv.Component.SubCategory = "1 || IO"
try: ghenv.Component.AdditionalHelpFromDocStrings = "1"
except: pass

import scriptcontext as sc
import os
import sys
import Grasshopper
import Rhino
import System

##################ShrimpGIS#####################
try:
    user_path = os.getenv("APPDATA")
    sys.path.append(user_path)
    from shrimp_gis import __version__, Location
    from shrimp_gis.io import GeojsonReader
    from shrimp_gis import Field
    ghenv.Component.Message = __version__
except ImportError as e:
    raise ImportError("\nFailed to import ShrimpGIS: {0}\n\nCheck your 'shrimp_gis' folder in {1}".format(e, os.getenv("APPDATA")))
################################################


def main():
    
    if run_it_:
        location = Location() if not _location_ else _location_
        
        reader = GeojsonReader(_geojson_file_)
        geometry = reader.get_georeferenced_rhino_geometry(location)
        
        return reader.fields, reader.type, geometry
    return [None]*3

field, type, geometry = main()
# ---------- end shrimp_read_geojson ----------
shrimp_dec_field = ShrimpGISDecomposeField(field=shrimp_read_geojson.field)  # -> read_me, name, values; inputs field: list
# ---------- shrimp_dec_field: Python ----------
# ShrimpGIS: A basic plugin to read and write shapefile (GPL).
# This file is part of ShrimpGIS.
#
# Copyright (c) 2020, Antonello Di Nunzio <antonellodinunzio@gmail.com>.
# You should have received a copy of the GNU General Public License
# along with ShrimpGIS; If not, see <http://www.gnu.org/licenses/>.
# 
# @license GPL-3.0+ <http://spdx.org/licenses/GPL-3.0+>

"""
Use this component to decompose ShrimpGIS Field and extract values.
    
    input:
        _field: Column with rows that comes from "ShrimpGIS Field" or "ShrimpGIS Write Shp".
    output:
        read_me: Message for users.
        name: Name of column.
        values: Records (rows) associated to geometries.
"""

ghenv.Component.Name = "ShrimpGIS Decompose Field"
ghenv.Component.NickName = "shrimp_dec_field"
ghenv.Component.Category = "ShrimpGIS"
ghenv.Component.SubCategory = "1 || IO"
try: ghenv.Component.AdditionalHelpFromDocStrings = "2"
except: pass

import scriptcontext as sc
import os
import sys
##################ShrimpGIS#####################
try:
    user_path = os.getenv("APPDATA")
    sys.path.append(user_path)
    from shrimp_gis import __version__
    from shrimp_gis.io import ShpReader
    ghenv.Component.Message = __version__
except ImportError as e:
    raise ImportError("\nFailed to import ShrimpGIS: {0}\n\nCheck your 'shrimp_gis' folder in {1}".format(e, os.getenv("APPDATA")))
################################################

def main():
    
    return ShpReader.decompose_fields(_field)

if (filter(None,_field)):
    values, name = main()
# ---------- end shrimp_dec_field ----------
flip = FlipMatrix(Data=shrimp_dec_field.values)

# ---- group: Visualization!
item = ListItem(List=flip, Index=0, Wrap=True)  # -> flatten(Item)
bnd = Bounds(Numbers=item)
dedomain = DeconstructDomain(Domain=bnd)  # -> Start, End
gradient = Gradient(
    LowerLimit=dedomain.Start,
    UpperLimit=dedomain.End,
    Parameter=item,
    stops=[0: RGB(0, 128, 0), 0.5: RGB(255, 255, 0), 1: RGB(255, 0, 0)])
graft = GraftTree(Tree=gradient, IncludeEmptyLists=True, IncludeNullItems=True)
preview = CustomPreview(Geometry=shrimp_read_geojson.geometry, Material=graft)

# ----
area = Area(Geometry=shrimp_read_geojson.geometry)  # -> Area, Centroid
panel_2 = Panel(shrimp_dec_field.name)
item_2 = ListItem(List=flip, Index="2", Wrap=True)
tag = TextTag3D(Location=area.Centroid, Text=item_2, Size="80", Colour=RGB(0, 0, 0), Justification=8)
