# Grasshopper definition write_geojson_with_many_types_by_merge.gh (Grasshopper 1.0.7)
# Copyright: Coprat

# ---- group: Anchor Location
# ShrimpGIS 1.0.3
# 
# How to write a geojson file with many GIS types.
# Be simple, merge together many geojson!
# -
# You can export data comes from
# other plugins such as Ladybug and
# Gismo.
# ++++++++++++++++++++++++++++
# Requirements:
# - Rhino6
# - ShrimpGIS
# ++++++++++++++++++++++++++++
# Author: Antonello Di Nunzio
# License: GPL V.3.0+
panel = Panel("BOSTON MA(USA)")
shrimp_location = ShrimpGISLocation(name=panel, latitude="42.3615101", longitude="-71.0616249")  # -> location; inputs anchor_point: Point3d
# ---------- shrimp_location: Python ----------
# ShrimpGIS: A basic plugin to read and write shapefile (GPL).
# This file is part of ShrimpGIS.
#
# Copyright (c) 2020, Antonello Di Nunzio <antonellodinunzio@gmail.com>.
# You should have received a copy of the GNU General Public License
# along with ShrimpGIS; If not, see <http://www.gnu.org/licenses/>.
# 
# @license GPL-3.0+ <http://spdx.org/licenses/GPL-3.0+>

"""
Construct a ShrimpGIS Location.
    Args:
        _name_: Name of Location.
        _latitude_: Latitude of Location WGS84 [float].
        _longitude_: Longitude of Location WGS84 [float].
        _altitude_: Altitude of Location in meter [float]. Use it for shapefile with Z values.
        _anchor_point_: Rhino point to use as anchor point of Location.
    
    Returns:
        location: ShrimpGIS Location.
"""

ghenv.Component.Name = "ShrimpGIS Location"
ghenv.Component.NickName = "shrimp_location"
ghenv.Component.Message = "1.0.0"
ghenv.Component.Category = "ShrimpGIS"
ghenv.Component.SubCategory = "0 || Settings"
try: ghenv.Component.AdditionalHelpFromDocStrings = "1"
except: pass

import scriptcontext as sc
import os
import sys
##################ShrimpGIS#####################
try:
    user_path = os.getenv("APPDATA")
    sys.path.append(user_path)
    from shrimp_gis import __version__
    from shrimp_gis import Location
    ghenv.Component.Message = __version__
except ImportError as e:
    raise ImportError("\nFailed to import ShrimpGIS: {0}\n\nCheck your 'shrimp_gis' folder in {1}".format(e, os.getenv("APPDATA")))
################################################

def main():
    
    location = Location()
    
    if _name_: location.name = _name_
    if _latitude_: location.latitude = _latitude_
    if _longitude_: location.longitude = _longitude_
    if _altitude_: location.altitude = _altitude_
    if _anchor_point_: location.anchor_point = _anchor_point_
    
    return location

location = main()
# ---------- end shrimp_location ----------

# ----
srf = Surface([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])
crv = Curve([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])

# ---- group: Set Fields
area = Area(Geometry=srf)  # -> Area, Centroid
ma = MassAddition(Input=area.Area)  # -> Result, PartialResults
shrimp_field = ShrimpGISField(name="TOT-AREA", values=ma.Result, type="2", decimal="2")  # -> read_me, field; inputs values: list, type: Int32, length: Int32, decimal: Int32
# ---------- shrimp_field: Python ----------
# ShrimpGIS: A basic plugin to read and write shapefile (GPL).
# This file is part of ShrimpGIS.
#
# Copyright (c) 2020, Antonello Di Nunzio <antonellodinunzio@gmail.com>.
# You should have received a copy of the GNU General Public License
# along with ShrimpGIS; If not, see <http://www.gnu.org/licenses/>.
# 
# @license GPL-3.0+ <http://spdx.org/licenses/GPL-3.0+>

"""
Construct a ShrimpGIS Field.
-
Try to export data from other plugin, such as Ladybug and Gismo!
    Args:
        _type_: Type of key to write. Default value is 'C' (character).
        -
        0 = Characters, text.
        1 = Numbers, with or without decimals.
        2 = Floats (same as "N").
        3 = Logical, for boolean values. Required input 0 or 1.
        4 = Dates. Required input format YYYYMMDD.
        5 = Memo, has no meaning within a GIS and is part of the xbase spec instead.
        key_: Name of column. Default value is 'MyField'.
        length_: Length of key. Default is 40.
        decimal_: Number of decimal places found in number key.
        _values: Records (rows) to export to shapefile.
    
    Returns:
        read_me: Message for users.
        field: Column with rows to write within shp file.
"""

ghenv.Component.Name = "ShrimpGIS Field"
ghenv.Component.NickName = "shrimp_field"
ghenv.Component.Category = "ShrimpGIS"
ghenv.Component.SubCategory = "0 || Settings"
try: ghenv.Component.AdditionalHelpFromDocStrings = "1"
except: pass

import scriptcontext as sc
import os
import sys
##################ShrimpGIS#####################
try:
    user_path = os.getenv("APPDATA")
    sys.path.append(user_path)
    from shrimp_gis import __version__
    from shrimp_gis import Field
    ghenv.Component.Message = __version__
except ImportError as e:
    raise ImportError("\nFailed to import ShrimpGIS: {0}\n\nCheck your 'shrimp_gis' folder in {1}".format(e, os.getenv("APPDATA")))
################################################

def main():
    
    if _values:
        
        field = Field(_values)
        
        if name_: field.name = name_
        if _type_: field.type = Field.get_type(_type_)
        if length_: field.length = length_
        if decimal_: field.decimal = decimal_
        
        return field
    else:
        return

field = main()
if not field: print("Please, connect values.")
# ---------- end shrimp_field ----------

len = Length(Curve=crv)
shrimp_field_2 = ShrimpGISField(name="LENGTH", values=len, type="2", decimal="2")  # -> read_me, field; inputs values: list, type: Int32, length: Int32, decimal: Int32; same code as shrimp_field

# ---- group: ShrimpGIS curves
shrimp_curve = ShrimpGISCurve(curve=flatten(crv), location=shrimp_location, num="5")  # -> shp_curve; inputs curve: list of Curve, num: Int32
#   port curve: A Rhino or Grasshopper Brep/Surface to export.
# ---------- shrimp_curve: Python ----------
# ShrimpGIS: A basic plugin to read and write shapefile (GPL).
# This file is part of ShrimpGIS.
#
# Copyright (c) 2020, Antonello Di Nunzio <antonellodinunzio@gmail.com>.
# You should have received a copy of the GNU General Public License
# along with ShrimpGIS; If not, see <http://www.gnu.org/licenses/>.
# 
# @license GPL-3.0+ <http://spdx.org/licenses/GPL-3.0+>

"""
Construct a ShrimpGIS Curve.
    Args:
        _surface: A Rhino or Grasshopper Curve to export.
        _location_: ShrimpGIS Location.
        _num_: Number of point to consider for discretization of curves. If it is a polyline component automatically recognizes points.
        -
        Default value is 10.
    
    Returns:
        shp_curve: ShrimpGIS Curve [plugin::type::n.point].
"""

ghenv.Component.Name = "ShrimpGIS Curve"
ghenv.Component.NickName = "shrimp_curve"
ghenv.Component.Category = "ShrimpGIS"
ghenv.Component.SubCategory = "0 || Settings"
try: ghenv.Component.AdditionalHelpFromDocStrings = "2"
except: pass

import scriptcontext as sc
import os
import sys
##################ShrimpGIS#####################
try:
    user_path = os.getenv("APPDATA")
    sys.path.append(user_path)
    from shrimp_gis import __version__
    from shrimp_gis import Location
    from shrimp_gis.geometry import ShpCurve
    from shrimp_gis.io import get_latlon_from_location
    ghenv.Component.Message = __version__
except ImportError as e:
    raise ImportError("\nFailed to import ShrimpGIS: {0}\n\nCheck your 'shrimp_gis' folder in {1}".format(e, os.getenv("APPDATA")))
################################################

import scriptcontext as sc
import Grasshopper
import Rhino

warning = Grasshopper.Kernel.GH_RuntimeMessageLevel.Warning

def is_in_meter():
    units = sc.doc.ModelUnitSystem
    if `units` != 'Rhino.UnitSystem.Meters': return False
    return True

def main():
    
    if not is_in_meter():
        ghenv.Component.AddRuntimeMessage(warning, "Rhino model have to be in meter.")
        return
    
    location = Location() if not _location_ else _location_
    num = 10 if not _num_ else _num_
    
    if _curve:
        shp_curve = [ShpCurve(crv, num) for crv in _curve]
        for geo in shp_curve:
            geo.coordinates = get_latlon_from_location(geo.points, location)
        
        return shp_curve

shp_curve = main()
# ---------- end shrimp_curve ----------

# ---- group: ShrimpGIS polygon
shrimp_polygon = ShrimpGISPolygon(surface=flatten(srf), location=shrimp_location)  # -> shp_polygon; inputs surface: list of Brep, num: Int32
# ---------- shrimp_polygon: Python ----------
# ShrimpGIS: A basic plugin to read and write shapefile (GPL).
# This file is part of ShrimpGIS.
#
# Copyright (c) 2020, Antonello Di Nunzio <antonellodinunzio@gmail.com>.
# You should have received a copy of the GNU General Public License
# along with ShrimpGIS; If not, see <http://www.gnu.org/licenses/>.
# 
# @license GPL-3.0+ <http://spdx.org/licenses/GPL-3.0+>

"""
Construct a ShrimpGIS Polygon.
    Args:
        _surface: A Rhino or Grasshopper Brep/Surface to export.
        _location_: ShrimpGIS Location.
        _num_: Number of point to consider for discretization of curves. If it is a polyline component automatically recognizes points.
        -
        Default value is 10.
    
    Returns:
        shp_polygon: ShrimpGIS Polygon [plugin::type::n.polygon].
"""

ghenv.Component.Name = "ShrimpGIS Polygon"
ghenv.Component.NickName = "shrimp_polygon"
ghenv.Component.Category = "ShrimpGIS"
ghenv.Component.SubCategory = "0 || Settings"
try: ghenv.Component.AdditionalHelpFromDocStrings = "2"
except: pass

import scriptcontext as sc
import os
import sys
##################ShrimpGIS#####################
try:
    user_path = os.getenv("APPDATA")
    sys.path.append(user_path)
    from shrimp_gis import __version__
    from shrimp_gis import Location
    from shrimp_gis.geometry import ShpPolygon
    from shrimp_gis.io import get_latlon_from_location
    ghenv.Component.Message = __version__
except ImportError as e:
    raise ImportError("\nFailed to import ShrimpGIS: {0}\n\nCheck your 'shrimp_gis' folder in {1}".format(e, os.getenv("APPDATA")))
################################################

import scriptcontext as sc
import Grasshopper
import Rhino

warning = Grasshopper.Kernel.GH_RuntimeMessageLevel.Warning

def is_in_meter():
    units = sc.doc.ModelUnitSystem
    if `units` != 'Rhino.UnitSystem.Meters': return False
    return True

def main():
    
    if not is_in_meter():
        ghenv.Component.AddRuntimeMessage(warning, "Rhino model have to be in meter.")
        return
    
    location = Location() if not _location_ else _location_
    num = 10 if not _num_ else _num_
    
    if _surface:
        shp_polygon = [ShpPolygon(srf, num) for srf in _surface]
        for geo in shp_polygon:
            geo.coordinates = []
            for pts in geo.points:
                geo.coordinates.append(get_latlon_from_location(pts, location))
        
        return shp_polygon

shp_polygon = main()
# ---------- end shrimp_polygon ----------

# ---- group: Multi!
shrimp_multi_geometry = ShrimpGISMultiGeometry(shp_geometry=flatten(shrimp_polygon))  # -> shp_multi; inputs shp_geometry: list
# ---------- shrimp_multi_geometry: Python ----------
# ShrimpGIS: A basic plugin to read and write shapefile (GPL).
# This file is part of ShrimpGIS.
#
# Copyright (c) 2020, Antonello Di Nunzio <antonellodinunzio@gmail.com>.
# You should have received a copy of the GNU General Public License
# along with ShrimpGIS; If not, see <http://www.gnu.org/licenses/>.
# 
# @license GPL-3.0+ <http://spdx.org/licenses/GPL-3.0+>

"""
Construct a ShrimpGIS MultiGeometry to use with geojson. It puts many geometry entities of the same family together.
-
REMARK: For Geojson only!
    Args:
        _shp_geometry: Connect a list of ShpCurves or ShpPoints or ShpSurfaces [list].
        
    Returns:
        shp_multi: ShrimpGIS MultiGeometry [plugin::type("multi" + type)::n.geometries].
"""

ghenv.Component.Name = "ShrimpGIS MultiGeometry"
ghenv.Component.NickName = "shrimp_multi_geometry"
ghenv.Component.Category = "ShrimpGIS"
ghenv.Component.SubCategory = "0 || Settings"
try: ghenv.Component.AdditionalHelpFromDocStrings = "3"
except: pass

import scriptcontext as sc
import os
import sys
##################ShrimpGIS#####################
try:
    user_path = os.getenv("APPDATA")
    sys.path.append(user_path)
    from shrimp_gis import __version__
    from shrimp_gis.geometry import MultiGeometry
    ghenv.Component.Message = __version__
except ImportError as e:
    raise ImportError("\nFailed to import ShrimpGIS: {0}\n\nCheck your 'shrimp_gis' folder in {1}".format(e, os.getenv("APPDATA")))
################################################

import scriptcontext as sc
import Grasshopper
import Rhino

warning = Grasshopper.Kernel.GH_RuntimeMessageLevel.Warning

def is_in_meter():
    units = sc.doc.ModelUnitSystem
    if `units` != 'Rhino.UnitSystem.Meters': return False
    return True

def main():
    
    if not is_in_meter():
        ghenv.Component.AddRuntimeMessage(warning, "Rhino model have to be in meter.")
        return
    
    if _shp_geometry:
        shp_multi = MultiGeometry(_shp_geometry)
        
        return shp_multi

shp_multi = main()
# ---------- end shrimp_multi_geometry ----------

# ---- group: 1
toggle = BooleanToggle(False)

# ---- group: Replace with a dir path where to save geojson
python = GhPythonScript()  # -> geojson
# ---------- python: Python ----------
"""Get current path - for examples only"""

__author__ = "antonellodinunzio"

import os
file_name = ghenv.Component.OnPingDocument().FilePath
geojson = os.path.join(os.path.dirname(file_name), "out")
# ---------- end python ----------

# ---- group: 2
toggle_2 = BooleanToggle(False)

# ----
shrimp_write_geojson = ShrimpGISWriteGeojson(
    field=flatten(shrimp_field.field),
    shp_geometry=flatten(shrimp_multi_geometry),
    folder=python,
    name="file1",
    run_it=toggle)  # -> read_me, geojson_file; inputs field: list, shp_geometry: list, run_it: Boolean
# ---------- shrimp_write_geojson: Python ----------
# ShrimpGIS: A basic plugin to read and write shapefile (GPL).
# This file is part of ShrimpGIS.
#
# Copyright (c) 2020, Antonello Di Nunzio <antonellodinunzio@gmail.com>.
# You should have received a copy of the GNU General Public License
# along with ShrimpGIS; If not, see <http://www.gnu.org/licenses/>.
# 
# @license GPL-3.0+ <http://spdx.org/licenses/GPL-3.0+>

"""
It writes Geojson file - standard rfc7946.
-
More info about geojson compliant structure supported by ShrimpGIS here: https://en.wikipedia.org/wiki/GeoJSON
    Args:
        _field_: ShrimpGIS Fields to add to GIS geometries.
        -
        If nothing is added to this input, it will create just one column called UUID.
        _shp_geometry: Geometry to write into shapefile.
        -
        Connect following
        - ShrimpGIS point 
        - ShrimpGIS curve 
        - ShrimpGIS polygon 
        - ShrimpGIS mesh
        -
        Note that Geojson supports many types at the same time. You can do that.
        OR
        If you want to manage different fields, you can create multiple geojson and merge them together with "ShrimpGIS Merge Geojson".
        _folder: Path of directory where you want to save a geojson. For example, "C:\Example".
        _name_: Name of geojson which you want to save on your machine. Default name is the first <GEOTYPE>.
        run_it_: Set it to True to write geojson.
    
    Returns:
        read_me: Message for users.
        geojson_file: Complete path with extension of the geojson.
"""

ghenv.Component.Name = "ShrimpGIS Write Geojson"
ghenv.Component.NickName = "shrimp_write_geojson"
ghenv.Component.Category = "ShrimpGIS"
ghenv.Component.SubCategory = "1 || IO"
try: ghenv.Component.AdditionalHelpFromDocStrings = "1"
except: pass

import scriptcontext as sc
import os
import sys
import Grasshopper
import Rhino

##################ShrimpGIS#####################
try:
    user_path = os.getenv("APPDATA")
    sys.path.append(user_path)
    from shrimp_gis import __version__
    from shrimp_gis.io import GeojsonWriter
    ghenv.Component.Message = __version__
except ImportError as e:
    raise ImportError("\nFailed to import ShrimpGIS: {0}\n\nCheck your 'shrimp_gis' folder in {1}".format(e, os.getenv("APPDATA")))
################################################

warning = Grasshopper.Kernel.GH_RuntimeMessageLevel.Warning

def main():
    
    main_type = _shp_geometry[0].name
    
    name = main_type if _name_ == None else _name_
    
    if None in _field_: print("There is an invalid field."); return
    
    if (run_it_):
        shp_write = GeojsonWriter()
        result = shp_write.write_geojson_file(_folder, name, _shp_geometry, _field_)
        
        if result == False:
                ghenv.Component.AddRuntimeMessage(warning, "Please make sure value of fields are equals to geometries count.")
        else:
            return result


geojson_file = main() if _shp_geometry and run_it_ and _folder != None else None
if not geojson_file:
    print("Add shp_geometry and folder.\nThen set run_it to 'True'.")
else:
    print("File written.")
# ---------- end shrimp_write_geojson ----------
panel_2 = Panel(shrimp_multi_geometry)
shrimp_write_geojson_2 = ShrimpGISWriteGeojson(field=flatten(shrimp_field_2.field), shp_geometry=flatten(shrimp_curve), folder=python, name="file2", run_it=toggle_2)  # -> read_me, geojson_file; inputs field: list, shp_geometry: list, run_it: Boolean; same code as shrimp_write_geojson
panel_3 = Panel(shrimp_curve)

# ---- group: Merge! / 3
toggle_3 = BooleanToggle(False)

# ---- group: Merge!
shrimp_merge_geojson = ShrimpGISMergeGeojson(
    geojson_file=flatten([shrimp_write_geojson.geojson_file, shrimp_write_geojson_2.geojson_file]),
    folder=python,
    name="mix",
    run_it=toggle_3)  # -> read_me, geojson_file; inputs geojson_file: list, run_it: Boolean
# ---------- shrimp_merge_geojson: Python ----------
# ShrimpGIS: A basic plugin to read and write shapefile (GPL).
# This file is part of ShrimpGIS.
#
# Copyright (c) 2020, Antonello Di Nunzio <antonellodinunzio@gmail.com>.
# You should have received a copy of the GNU General Public License
# along with ShrimpGIS; If not, see <http://www.gnu.org/licenses/>.
# 
# @license GPL-3.0+ <http://spdx.org/licenses/GPL-3.0+>

"""
This is a special component that merges together geojson files with features into a new file.
-
It is very helpful if you work with separate and massive geojson and then you want to create just one file for them.
E.g. a point layer with information about trees; a polygon layer with information about building and so on.
    Args:
        _geojson_file: geojson files to merge.
        -
        Standard rfc7946. Reference here: https://en.wikipedia.org/wiki/GeoJSON
        _folder: Path of directory where you want to save geojson file. For example, "C:\Example".
        _name_: Name of geojson which you want to save on your machine. Default name is "Geojson".
        run_it_: Set it to True to write geojson.
    
    Returns:
        read_me: Message for users.
        geojson_file: Complete path with extension of the new geojson.
"""

ghenv.Component.Name = "ShrimpGIS Merge Geojson"
ghenv.Component.NickName = "shrimp_merge_geojson"
ghenv.Component.Category = "ShrimpGIS"
ghenv.Component.SubCategory = "1 || IO"
try: ghenv.Component.AdditionalHelpFromDocStrings = "2"
except: pass

import scriptcontext as sc
import os
import sys
import Grasshopper
import Rhino

##################ShrimpGIS#####################
try:
    user_path = os.getenv("APPDATA")
    sys.path.append(user_path)
    from shrimp_gis import __version__
    from shrimp_gis.io import GeojsonWriter
    ghenv.Component.Message = __version__
except ImportError as e:
    raise ImportError("\nFailed to import ShrimpGIS: {0}\n\nCheck your 'shrimp_gis' folder in {1}".format(e, os.getenv("APPDATA")))
################################################

warning = Grasshopper.Kernel.GH_RuntimeMessageLevel.Warning

def main():
    
    name = "Geojson" if _name_ == None else _name_
    
    if (run_it_):
        result = GeojsonWriter.merge_geojson(_folder, name, _geojson_file)
        
        return result


geojson_file = main() if _geojson_file and run_it_ and _folder != None else None
if not geojson_file:
    print("Add _geojson_file and folder.\nThen set run_it to 'True'.")
else:
    print("File written.")
# ---------- end shrimp_merge_geojson ----------
