# Grasshopper definition from_lbt_to_shp.gh (Grasshopper 1.0.7)

# ShrimpGIS 1.0.3
# 
# How to write a geojson file with many GIS types.
# Be simple, merge together many geojson!
# -
# You can export data comes from
# other plugins such as Ladybug and
# Gismo.
# ++++++++++++++++++++++++++++
# Requirements:
# - Rhino6
# - ShrimpGIS
# - LBT
# ++++++++++++++++++++++++++++
# Author: Antonello Di Nunzio
# License: GPL V.3.0+
panel = Panel("https://www.energyplus.net/weather-download/europe_wmo_region_6/ITA//ITA_Campobasso.162520_IGDG/all")
downloadepw = LBDownloadWeather(weather_URL=panel)  # -> epw_file, stat_file, ddy_file; plug-in component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
importepw = LBImportEPW(epw_file=downloadepw.epw_file)  # -> location, dry_bulb_temperature, dew_point_temperature, relative_humidity, wind_speed, wind_direction, direct_normal_rad, diffuse_horizontal_rad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; plug-in component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
windrose = LBWindRose(data=importepw.wind_speed, wind_direction=importepw.wind_direction, show_freq=Toggle(False))  # -> report, mesh, compass, orient_line, freq_line, legend, title, prevailing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; plug-in component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
decnstrloc = LBDeconstructLocation(location=importepw.location)  # -> name, latitude, longitude, time_zone, elevation; plug-in component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
shrimp_location = ShrimpGISLocation(name=decnstrloc.name, latitude=decnstrloc.latitude, longitude=decnstrloc.longitude)  # -> location; inputs anchor_point: Point3d
# ---------- shrimp_location: Python ----------
# ShrimpGIS: A basic plugin to read and write shapefile (GPL).
# This file is part of ShrimpGIS.
#
# Copyright (c) 2020, Antonello Di Nunzio <antonellodinunzio@gmail.com>.
# You should have received a copy of the GNU General Public License
# along with ShrimpGIS; If not, see <http://www.gnu.org/licenses/>.
# 
# @license GPL-3.0+ <http://spdx.org/licenses/GPL-3.0+>

"""
Construct a ShrimpGIS Location.
    Args:
        _name_: Name of Location.
        _latitude_: Latitude of Location WGS84 [float].
        _longitude_: Longitude of Location WGS84 [float].
        _altitude_: Altitude of Location in meter [float]. Use it for shapefile with Z values.
        _anchor_point_: Rhino point to use as anchor point of Location.
    
    Returns:
        location: ShrimpGIS Location.
"""

ghenv.Component.Name = "ShrimpGIS Location"
ghenv.Component.NickName = "shrimp_location"
ghenv.Component.Message = "1.0.0"
ghenv.Component.Category = "ShrimpGIS"
ghenv.Component.SubCategory = "0 || Settings"
try: ghenv.Component.AdditionalHelpFromDocStrings = "1"
except: pass

import scriptcontext as sc
import os
import sys
##################ShrimpGIS#####################
try:
    user_path = os.getenv("APPDATA")
    sys.path.append(user_path)
    from shrimp_gis import __version__
    from shrimp_gis import Location
    ghenv.Component.Message = __version__
except ImportError as e:
    raise ImportError("\nFailed to import ShrimpGIS: {0}\n\nCheck your 'shrimp_gis' folder in {1}".format(e, os.getenv("APPDATA")))
################################################

def main():
    
    location = Location()
    
    if _name_: location.name = _name_
    if _latitude_: location.latitude = _latitude_
    if _longitude_: location.longitude = _longitude_
    if _altitude_: location.altitude = _altitude_
    if _anchor_point_: location.anchor_point = _anchor_point_
    
    return location

location = main()
# ---------- end shrimp_location ----------
faceb = FaceBoundaries(Mesh=windrose.mesh)
boundary = BoundarySurfaces(Edges=faceb)

shrimp_polygon = ShrimpGISPolygon(surface=flatten(boundary), location=shrimp_location)  # -> shp_polygon; inputs surface: list of Brep, num: Int32
# ---------- shrimp_polygon: Python ----------
# ShrimpGIS: A basic plugin to read and write shapefile (GPL).
# This file is part of ShrimpGIS.
#
# Copyright (c) 2020, Antonello Di Nunzio <antonellodinunzio@gmail.com>.
# You should have received a copy of the GNU General Public License
# along with ShrimpGIS; If not, see <http://www.gnu.org/licenses/>.
# 
# @license GPL-3.0+ <http://spdx.org/licenses/GPL-3.0+>

"""
Construct a ShrimpGIS Polygon.
    Args:
        _surface: A Rhino or Grasshopper Brep/Surface to export.
        _location_: ShrimpGIS Location.
        _num_: Number of point to consider for discretization of curves. If it is a polyline component automatically recognizes points.
        -
        Default value is 10.
    
    Returns:
        shp_polygon: ShrimpGIS Polygon [plugin::type::n.polygon].
"""

ghenv.Component.Name = "ShrimpGIS Polygon"
ghenv.Component.NickName = "shrimp_polygon"
ghenv.Component.Category = "ShrimpGIS"
ghenv.Component.SubCategory = "0 || Settings"
try: ghenv.Component.AdditionalHelpFromDocStrings = "2"
except: pass

import scriptcontext as sc
import os
import sys
##################ShrimpGIS#####################
try:
    user_path = os.getenv("APPDATA")
    sys.path.append(user_path)
    from shrimp_gis import __version__
    from shrimp_gis import Location
    from shrimp_gis.geometry import ShpPolygon
    from shrimp_gis.io import get_latlon_from_location
    ghenv.Component.Message = __version__
except ImportError as e:
    raise ImportError("\nFailed to import ShrimpGIS: {0}\n\nCheck your 'shrimp_gis' folder in {1}".format(e, os.getenv("APPDATA")))
################################################

import scriptcontext as sc
import Grasshopper
import Rhino

warning = Grasshopper.Kernel.GH_RuntimeMessageLevel.Warning

def is_in_meter():
    units = sc.doc.ModelUnitSystem
    if `units` != 'Rhino.UnitSystem.Meters': return False
    return True

def main():
    
    if not is_in_meter():
        ghenv.Component.AddRuntimeMessage(warning, "Rhino model have to be in meter.")
        return
    
    location = Location() if not _location_ else _location_
    num = 10 if not _num_ else _num_
    
    if _surface:
        shp_polygon = [ShpPolygon(srf, num) for srf in _surface]
        for geo in shp_polygon:
            geo.coordinates = []
            for pts in geo.points:
                geo.coordinates.append(get_latlon_from_location(pts, location))
        
        return shp_polygon

shp_polygon = main()
# ---------- end shrimp_polygon ----------
shrimp_field = ShrimpGISField(name="frequency", values=windrose.frequency, type="2", decimal="4")  # -> read_me, field; inputs values: list, type: Int32, length: Int32, decimal: Int32
# ---------- shrimp_field: Python ----------
# ShrimpGIS: A basic plugin to read and write shapefile (GPL).
# This file is part of ShrimpGIS.
#
# Copyright (c) 2020, Antonello Di Nunzio <antonellodinunzio@gmail.com>.
# You should have received a copy of the GNU General Public License
# along with ShrimpGIS; If not, see <http://www.gnu.org/licenses/>.
# 
# @license GPL-3.0+ <http://spdx.org/licenses/GPL-3.0+>

"""
Construct a ShrimpGIS Field.
-
Try to export data from other plugin, such as Ladybug and Gismo!
    Args:
        _type_: Type of key to write. Default value is 'C' (character).
        -
        0 = Characters, text.
        1 = Numbers, with or without decimals.
        2 = Floats (same as "N").
        3 = Logical, for boolean values. Required input 0 or 1.
        4 = Dates. Required input format YYYYMMDD.
        5 = Memo, has no meaning within a GIS and is part of the xbase spec instead.
        key_: Name of column. Default value is 'MyField'.
        length_: Length of key. Default is 40.
        decimal_: Number of decimal places found in number key.
        _values: Records (rows) to export to shapefile.
    
    Returns:
        read_me: Message for users.
        field: Column with rows to write within shp file.
"""

ghenv.Component.Name = "ShrimpGIS Field"
ghenv.Component.NickName = "shrimp_field"
ghenv.Component.Category = "ShrimpGIS"
ghenv.Component.SubCategory = "0 || Settings"
try: ghenv.Component.AdditionalHelpFromDocStrings = "1"
except: pass

import scriptcontext as sc
import os
import sys
##################ShrimpGIS#####################
try:
    user_path = os.getenv("APPDATA")
    sys.path.append(user_path)
    from shrimp_gis import __version__
    from shrimp_gis import Field
    ghenv.Component.Message = __version__
except ImportError as e:
    raise ImportError("\nFailed to import ShrimpGIS: {0}\n\nCheck your 'shrimp_gis' folder in {1}".format(e, os.getenv("APPDATA")))
################################################

def main():
    
    if _values:
        
        field = Field(_values)
        
        if name_: field.name = name_
        if _type_: field.type = Field.get_type(_type_)
        if length_: field.length = length_
        if decimal_: field.decimal = decimal_
        
        return field
    else:
        return

field = main()
if not field: print("Please, connect values.")
# ---------- end shrimp_field ----------
shrimp_field_2 = ShrimpGISField(name="evg_val", values=windrose.avg_val, type="2", decimal="4")  # -> read_me, field; inputs values: list, type: Int32, length: Int32, decimal: Int32; same code as shrimp_field

python = GhPythonScript()  # -> output
# ---------- python: Python ----------
"""Get current path - for examples only"""

__author__ = "antonellodinunzio"

import os

file_name = ghenv.Component.OnPingDocument().FilePath

output = os.path.join(os.path.dirname(file_name), "out")
# ---------- end python ----------

# ---- group: 1
toggle = BooleanToggle(False)

# ----
shrimp_write_shp = ShrimpGISWriteShp(
    field=flatten([shrimp_field.field, shrimp_field_2.field]),
    shp_geometry=flatten(shrimp_polygon),
    folder=python,
    run_it=toggle)  # -> read_me, shp_file; inputs field: list, shp_geometry: list, run_it: Boolean
# ---------- shrimp_write_shp: Python ----------
# ShrimpGIS: A basic plugin to read and write shapefile (GPL).
# This file is part of ShrimpGIS.
#
# Copyright (c) 2020, Antonello Di Nunzio <antonellodinunzio@gmail.com>.
# You should have received a copy of the GNU General Public License
# along with ShrimpGIS; If not, see <http://www.gnu.org/licenses/>.
# 
# @license GPL-3.0+ <http://spdx.org/licenses/GPL-3.0+>

"""
It writes ESRI Shapefiles WGS84.
    Args:
        _field_: ShrimpGIS Fields to add to GIS geometries.
        -
        If nothing added to this input, it will be created just one column called UUID.
        _shp_geometry: Geometry to write into shapefile.
        -
        Connect a type of following
        - ShrimpGIS point 
        - ShrimpGIS curve 
        - ShrimpGIS polygon 
        - ShrimpGIS mesh
        _folder: Path of directory where you want to save a shapefile. For example, "C:\Example".
        _name_: Name of shapefile which you want to save on your machine. Default name is <GEOTYPE>.
        run_it_: Set it to True to write shapefile.
    
    Returns:
        read_me: Message for users.
        shp_file: Complete path with extension of the shapefile.
"""

ghenv.Component.Name = "ShrimpGIS Write Shp"
ghenv.Component.NickName = "shrimp_write_shp"
ghenv.Component.Category = "ShrimpGIS"
ghenv.Component.SubCategory = "1 || IO"
try: ghenv.Component.AdditionalHelpFromDocStrings = "1"
except: pass

import scriptcontext as sc
import os
import sys
import Grasshopper
import Rhino

##################ShrimpGIS#####################
try:
    user_path = os.getenv("APPDATA")
    sys.path.append(user_path)
    from shrimp_gis import __version__
    from shrimp_gis.io import ShpWriter
    ghenv.Component.Message = __version__
except ImportError as e:
    raise ImportError("\nFailed to import ShrimpGIS: {0}\n\nCheck your 'shrimp_gis' folder in {1}".format(e, os.getenv("APPDATA")))
################################################



def main():
    
    warning = Grasshopper.Kernel.GH_RuntimeMessageLevel.Warning
    
    main_type = _shp_geometry[0].name
    
    name = main_type if _name_ == None else _name_
    
    if None in _field_: print("There is an invalid field."); return
    
    if (run_it_):
        shp_write = ShpWriter()
        result = shp_write.write_shp_file(_folder, name, _shp_geometry, _field_)
        
        if result == False:
                ghenv.Component.AddRuntimeMessage(warning, "Please make sure you are using just one geometry type (e.g. all points) and count of value of fields are equals to geometries count.")
        else:
            return result


shp_file = main() if _shp_geometry and run_it_ and _folder != None else None
if not shp_file:
    print("Add shp_geometry and folder.\nThen set run_it to 'True'.")
else:
    print("File written.")
# ---------- end shrimp_write_shp ----------
